# Grasshopper definition abb_irb_6700_rrc_motion_planning.gh (Grasshopper 1.0.7)

info = Info()  # -> info
#   port info: Environment info.
# ---------- info: Python ----------
"""
Displays information about the active COMPAS environment.
"""
import compas_bootstrapper
from ghpythonlib.componentbase import executingcomponent as component

import compas
import compas_fab


class CompasInfo(component):
    def RunScript(self):
        self.Message = 'COMPAS v{}'.format(compas.__version__)
        info = 'COMPAS Version: {}\nEnvironment: {}\nCOMPAS FAB Version:{}'
        return (info.format(compas.__version__, compas_bootstrapper.ENVIRONMENT_NAME,compas_fab.__version__))
# ---------- end info ----------

# ----
# Configuration A
a7 = Slider(0, range=-360..360)
a1 = Slider(6.7, range=0..6.7)
a2 = Slider(-25, range=-360..360)
a4 = Slider(0, range=-360..360)
a5 = Slider(0, range=-360..360)
a3 = Slider(0, range=-360..360)
a6 = Slider(0, range=-360..360)
config = PythonScript(vals=[a1, a2, a3, a4, a5, a6, a7])  # -> config; inputs vals: list
# ---------- config: Python ----------
import math
from compas.robots import Configuration

config = Configuration.from_prismatic_and_revolute_values([vals[0]],[math.radians(a) for a in vals[1:]])
print config.values
# ---------- end config ----------

# ----
# Load Robot
connect = BooleanToggle(True)
ros_connect = ROSConnect(connect=connect)  # -> ros_client, is_connected; inputs port: Int32, connect: Boolean
#   port ip: The ip address ROS. Defaults to 127.0.0.1.
#   port port: The port of ROS. Defaults to 9090.
#   port connect: If True, connects to ROS. If False, disconnects from ROS. Defaults to False.
#   port ros_client: The ROS client.
#   port is_connected: True if connection established.
# ---------- ros_connect: Python ----------
"""
Connect or disconnect to ROS.

COMPAS FAB v0.27.0
"""
from ghpythonlib.componentbase import executingcomponent as component
from scriptcontext import sticky as st

from compas_fab.backends import RosClient
from compas_fab.ghpython.components import create_id


class ROSConnect(component):
    def RunScript(self, ip, port, connect):
        ros_client = None

        ip = ip or '127.0.0.1'
        port = port or 9090

        key = create_id(self, 'ros_client')
        ros_client = st.get(key, None)

        if ros_client:
            st[key].close()
        if connect:
            st[key] = RosClient(ip, port)
            st[key].run(5)

        ros_client = st.get(key, None)
        is_connected = ros_client.is_connected if ros_client else False
        return (ros_client, is_connected)
# ---------- end ros_connect ----------
load_robot = BooleanToggle(True)
# Package Version: {0}
# 0. COMPAS Version: 1.15.1
# Environment: fs2022
# COMPAS FAB Version:0.24.0
ros_robot = ROSRobot(ros_client=ros_connect.ros_client, load=load_robot)  # -> robot; inputs load: Boolean
#   port ros_client: The ROS client.
#   port load: If True, loads the robot from ROS. Defaults to False.
# ---------- ros_robot: Python ----------
"""
Load robot directly from ROS.

COMPAS FAB v0.27.0
"""
from compas_ghpython.artists import RobotModelArtist
from ghpythonlib.componentbase import executingcomponent as component
from scriptcontext import sticky as st

from compas_fab.ghpython.components import create_id


class ROSRobot(component):
    def RunScript(self, ros_client, load):
        key = create_id(self, 'robot')

        if ros_client and ros_client.is_connected and load:
            # Load URDF from ROS
            st[key] = ros_client.load_robot(load_geometry=True, precision='12f')
            st[key].artist = RobotModelArtist(st[key].model)

        robot = st.get(key, None)
        if robot:  # client sometimes need to be restarted, without needing to reload geometry
            robot.client = ros_client
        return robot
# ---------- end ros_robot ----------

# ----
# ABB IRB6700 - 02162023
# Author: Jingwen Wang
# Email: jingwen.wang@epfl.ch
# Package Version: COMPAS Version: 1.17.4
# COMPAS FAB Version:0.27.0
your_version = Panel(info)
panel = Panel("""-0.287
-1.919
-42.45""")
pos1 = Data([-0.287, -1.919, -46.435])
crv = Curve(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)
pln = Plane(crv)
item = ListItem(List=panel, Index=0, Wrap=True)  # -> Item, Item1, Item2

# ----
# Planes
pdecon = Deconstruct(Point=pln)  # -> XComponent, YComponent, ZComponent

# ----
# Visualize Robot
boolean_toggle = BooleanToggle(True)
robot_visualize = RobotVisualize(robot=ros_robot, configuration=config, show_end_effector_frame=boolean_toggle)  # -> visual, collision, attached_meshes, frames, base_frame, ee_frame; inputs attached_collision_meshes: list, show_visual: Boolean, show_collision: Boolean, show_frames: Boolean, show_base_frame: Boolean, show_end_effector_frame: Boolean, show_acm: Boolean
#   port group: The planning group used for end-effector and base visualization.
#   port configuration: The robot's full configuration.
#   port attached_collision_meshes: A list of attached collision meshes.
#   port show_visual: Whether or not to show the robot's visual meshes.
#   port show_collision: Whether or not to show the robot's collision meshes.
#   port show_frames: Whether or not to show the robot's joint frames.
#   port show_base_frame: Whether or not to show the robot's base frame.
#   port show_end_effector_frame: Whether or not to show the robot's end-effector frame.
#   port show_acm: Whether or not to show the attached collision meshes (if any).
#   port visual: The robot's visual Rhino meshes (if any).
#   port collision: The robot's collision Rhino meshes (if any).
#   port attached_meshes: The attached collision Rhino meshes (if any).
#   port frames: The robot's joint frames as Rhino planes (if any).
#   port base_frame: The robot's base frame as a Rhino plane (if any).
#   port ee_frame: The robot's end-effector frame as a Rhino plane (if any).
# ---------- robot_visualize: Python ----------
"""
Visualizes the robot.

COMPAS FAB v0.24.0
"""
from compas.geometry import Frame
from compas.geometry import Transformation
from compas_ghpython.artists import FrameArtist
from compas_ghpython.artists import MeshArtist
from ghpythonlib.componentbase import executingcomponent as component


class RobotVisualize(component):
    def RunScript(self, robot, group, configuration, attached_collision_meshes, show_visual, show_collision,
                  show_frames, show_base_frame, show_end_effector_frame, show_acm):

        visual = None
        collision = None
        attached_meshes = None
        frames = None
        base_frame = None
        ee_frame = None

        if robot:
            show_visual = True if show_visual is None else show_visual
            configuration = configuration or robot.zero_configuration()

            robot.update(configuration, visual=show_visual, collision=show_collision)
            compas_frames = robot.transformed_frames(configuration, group)

            if show_visual:
                visual = robot.artist.draw_visual()

            if show_collision:
                collision = robot.artist.draw_collision()

            if show_base_frame:
                base_compas_frame = compas_frames[0]
                artist = FrameArtist(base_compas_frame)
                base_frame = artist.draw()

            if show_end_effector_frame:
                ee_compas_frame = robot.forward_kinematics(configuration, group, options=dict(solver='model'))
                artist = FrameArtist(ee_compas_frame)
                ee_frame = artist.draw()

            if show_frames:
                frames = []
                for compas_frame in compas_frames[1:]:
                    artist = FrameArtist(compas_frame)
                    frame = artist.draw()
                    frames.append(frame)

            if show_acm:
                attached_meshes = []
                for acm in attached_collision_meshes:
                    frame = robot.forward_kinematics(configuration, options=dict(solver='model', link_name=acm.link_name))
                    T = Transformation.from_frame_to_frame(Frame.worldXY(), frame)
                    mesh = acm.collision_mesh.mesh.transformed(T)
                    attached_meshes.append(MeshArtist(mesh).draw())

        return (visual, collision, attached_meshes, frames, base_frame, ee_frame)
# ---------- end robot_visualize ----------

pt = ConstructPoint(XCoordinate=item.Item, YCoordinate=item.Item1, ZCoordinate=item.Item2)  # -> expr("-x/1000", Point)
move = Move(Geometry=pln, Motion=pt)  # -> Geometry, Transform

# ----
# Test Linear Axis with Move Joint
a1_2 = Slider(50, range=0..360)
a3_2 = Slider(-110, range=-360..360)
a6_2 = Slider(-35, range=-360..360)
a7_2 = Slider(-35, range=-360..360)
a2_2 = Slider(116, range=-360..360)
a4_2 = Slider(161, range=-360..360)
a5_2 = Slider(-27, range=-360..360)
config_2 = PythonScript(vals=[a1_2, a2_2, a3_2, a4_2, a5_2, a6_2, a7_2])  # -> config; inputs vals: list
# ---------- config_2: Python ----------
import math
from compas.robots import Configuration

config = Configuration.from_revolute_values([math.radians(a) for a in vals])
print config
# ---------- end config_2 ----------
inverse_kinematics = InverseKinematics(robot=ros_robot, plane=move.Geometry, start_configuration=config_2, group="manipulator")  # -> configuration
#   port plane: The plane or frame to calculate the inverse kinematic for.
#   port start_configuration: If passed, calculates the inverse such that the joint positions differ the least from the start_configuration. Defaults to the zero configuration.
#   port group: The planning group used for calculation. Defaults to the robot's main planning group.
#   port configuration: The planning group's configuration.
# ---------- inverse_kinematics: Python ----------
"""
Calculate the robot's inverse kinematic for a given plane.

COMPAS FAB v0.24.0
"""
from ghpythonlib.componentbase import executingcomponent as component
from compas.geometry import Frame
#Frame([0, 0, 0], [1, 0, 0], [0, 1, 0])
#from compas_fab.ghpython.components import 


class InverseKinematics(component):
    def RunScript(self, robot, plane, start_configuration, group):
        configuration = None
        if robot and robot.client and robot.client.is_connected and plane:
            frame = Frame([plane.Origin.X,plane.Origin.Y,plane.Origin.Z], [plane.XAxis.X,plane.XAxis.Y,plane.XAxis.Z], [plane.YAxis.X,plane.YAxis.Y,plane.YAxis.Z])
            #frame = coerce_frame(plane)
            configuration = robot.inverse_kinematics(frame, start_configuration, group)
        return configuration
# ---------- end inverse_kinematics ----------
config_3 = PythonScript(val0=a1_2, configuration=inverse_kinematics)  # -> config
# ---------- config_3: Python ----------
import math
from compas.robots import Configuration

combo = []
combo.append(math.radians(val0))
combo.extend(configuration.joint_values)
config = Configuration.from_revolute_values(combo)

print config
# ---------- end config_3 ----------

panel_2 = Panel([pdecon.XComponent, pdecon.YComponent, pdecon.ZComponent])

# ----
# Get Frame & Send Frame
ros_client = Data(ros_connect.ros_client)
python = GhPythonScript(ros=ros_client, run=Button(), speed=Slider(100, range=0..300))
# ---------- python: Python ----------
import compas_rrc as rrc
from compas.geometry import Frame, Translation
abb = rrc.AbbClient(ros, '/rob1')
print('Connected.')

if run : 

    frame = abb.send_and_wait(rrc.GetFrame())
    T = Translation.from_vector([50,0,0])
    frame = frame.transformed(T)
    abb.send_and_wait(rrc.MoveToFrame(frame, speed, rrc.Zone.FINE, rrc.Motion.LINEAR), timeout = 10)
# ---------- end python ----------

panel_3 = Panel("""986.08
2040.60
2030.49""")
multiplication = Multiplication(A=panel_2, B=Slider(1000, range=0..1000))
panel_4 = Panel(multiplication)
deconstruct = Deconstruct(Point=robot_visualize.ee_frame)  # -> XComponent, YComponent, ZComponent
subtraction = Subtraction(A=panel_3, B=multiplication)
panel_5 = Panel(subtraction)

# ----
# Visualize Robot
boolean_toggle_2 = BooleanToggle(True)
robot_visualize_2 = RobotVisualize(robot=ros_robot, configuration=config_3, show_end_effector_frame=boolean_toggle_2)  # -> visual, collision, attached_meshes, frames, base_frame, ee_frame; inputs attached_collision_meshes: list, show_visual: Boolean, show_collision: Boolean, show_frames: Boolean, show_base_frame: Boolean, show_end_effector_frame: Boolean, show_acm: Boolean; same code as robot_visualize

pos1_2 = Data([-0.287, -1.919, -46.435])
pos2 = Data([-0.287, -1.919, -46.435])
panel_6 = Panel(deconstruct.ZComponent)
panel_7 = Panel(deconstruct.YComponent)
panel_8 = Panel(deconstruct.XComponent)

# ----
# Get Joint & Send Joint
number_slider = Slider(100, range=0..300)
ros_client_2 = Data(ros_connect.ros_client)
python_2 = GhPythonScript(ros=ros_client_2, run=Button(), speed=number_slider)
# ---------- python_2: Python ----------
import compas_rrc as rrc
from compas.geometry import Frame, Translation
abb = rrc.AbbClient(ros, '/rob1')
print('Connected.')

if run : 

    # Get joints
    robot_joints, external_axes = abb.send_and_wait(rrc.GetJoints())
    
    # Print received values
    print(robot_joints, external_axes)
    
    # Change value and move to new position
    robot_joints.rax_1 += 15
    speed = 100 # Unit [mm/s]
    done = abb.send_and_wait(rrc.MoveToJoints(robot_joints, external_axes, speed, rrc.Zone.FINE))
# ---------- end python_2 ----------

panel_9 = Panel(pos1_2)
panel_10 = Panel(pos2)

# ----
# Send configurations as a list of values to the controller
number_slider_2 = Slider(300, range=0..300)
button = Button()
ros_client_3 = Data(ros_connect.ros_client)
python_3 = GhPythonScript(config=config_3, ros=ros_client_3, run=Toggle(False), speed=number_slider_2)  # -> out, a; inputs config: list
# ---------- python_3: Python ----------
import compas_rrc as rrc
import compas
import math
from compas.geometry import Frame, Translation
abb = rrc.AbbClient(ros, '/rob1')
print('Connected.')

if run : 

    # Get joints
    robot_joints, external_axes = abb.send_and_wait(rrc.GetJoints())
    
    # Print received values
    print(robot_joints, external_axes)
    
    for i in range(0, len(config)):
        # Change value and move to new position
        print(config[i].data)
        
        robot_joints_updated = [
            math.degrees(config[i].joint_values[1]),
            math.degrees(config[i].joint_values[2]),
            math.degrees(config[i].joint_values[3]),
            math.degrees(config[i].joint_values[4]),
            math.degrees(config[i].joint_values[5]),
            math.degrees(config[i].joint_values[6])
        ]
        external_axes_updated = [
            config[i].joint_values[0]*1000
        ]
        print(external_axes_updated)
        
        #frame = abb.send_and_wait(rrc.GetFrame())
        # T = Translation.from_vector([50,0,0])
        #frame[0].x = 1576
        #frame[0].y = 2407
        #frame[0].z = 1367
        #abb.send_and_wait(rrc.MoveToFrame(frame, speed, rrc.Zone.FINE, rrc.Motion.LINEAR), timeout = 10)
        
        #print(math.degrees(config.joint_values[1]))
        
        #robot_joints_updated = rrc.RobotJoints.from_configuration(config_)
        #external_axes_updated = [math.degrees(config.joint_values[0])]
        done = abb.send_and_wait(rrc.MoveToJoints(robot_joints_updated, external_axes_updated, speed, rrc.Zone.FINE))
# ---------- end python_3 ----------

deconstruct_2 = Deconstruct(Point=Point(0.9014668693, 1.91610483, 2.164683259))  # -> XComponent, YComponent, ZComponent
number_slider_3 = Slider(0.05, range=0..0.1)  # disabled
plane = Plane(robot_visualize.ee_frame)  # disabled
deconstruct_plane = DeconstructPlane(Plane=plane)  # -> Origin, XAxis, YAxis, ZAxis; disabled
panel_11 = Panel(deconstruct_2.ZComponent)
panel_12 = Panel(deconstruct_2.YComponent)
panel_13 = Panel(deconstruct_2.XComponent)
amplitude = Amplitude(Vector=deconstruct_plane.ZAxis, Amplitude=number_slider_3)  # disabled

# ----
# Get Robtarget & Send Robtarget
number_slider_4 = Slider(100, range=0..300)
ros_client_4 = Data(ros_connect.ros_client)
python_4 = GhPythonScript(ros=ros_client_4, run=Button(), speed=number_slider_4)
# ---------- python_4: Python ----------
import compas_rrc as rrc
from compas.geometry import Frame, Translation
abb = rrc.AbbClient(ros, '/rob1')
print('Connected.')

if run : 

    # Get frame and external axes
    frame, external_axes = abb.send_and_wait(rrc.GetRobtarget())
    
    # Print received values
    print(frame, external_axes)
    
    # Change any value and move to new position
    frame.point[0] += 50
    done = abb.send_and_wait(rrc.MoveToRobtarget(frame, external_axes, speed, rrc.Zone.FINE))
# ---------- end python_4 ----------

move_2 = Move(Geometry=plane, Motion=amplitude)  # -> Geometry, Transform; disabled
panel_14 = Panel(python_3.out)
deconstruct_3 = Deconstruct(Point=Point(7.591465886, 1.919069709, 2.166773902))  # -> XComponent, YComponent, ZComponent
panel_15 = Panel("""1.356
0.427
-0.259
-4.244
-1.330
5.024""")
data = Data(ros_robot)  # disabled
panel_16 = Panel(deconstruct_3.ZComponent)
panel_17 = Panel(deconstruct_3.YComponent)
panel_18 = Panel(deconstruct_3.XComponent)
constraints_from_plane = ConstraintsFromPlane(robot=data, plane=move_2.Geometry)  # -> constraints; disabled
#   port plane: The plane or frame from which we create position and orientation constraints.
#   port group: The planning group for which we specify the constraint. Defaults to the robot's main planning group.
#   port tolerance_position: The allowed tolerance to the frame's position (defined in the robot's units). Defaults to 0.001
#   port tolerance_xaxis: The allowed tolerance of the frame's X-axis in degrees.
#   port tolerance_yaxis: The allowed tolerance of the frame's Y-axis in degrees.
#   port tolerance_zaxis: The allowed tolerance of the frame's Z-axis in degrees.
#   port constraints: A list containing a position and an orientation constraint.
# ---------- constraints_from_plane: Python ----------
"""
Create a position and an orientation constraint from a plane calculated for the group's end-effector link.

COMPAS FAB v0.27.0
"""
import math

from compas_rhino.conversions import RhinoPlane
from ghpythonlib.componentbase import executingcomponent as component


class ConstraintsFromPlane(component):
    def RunScript(self, robot, plane, group, tolerance_position, tolerance_xaxis, tolerance_yaxis, tolerance_zaxis):
        goal_constraints = None
        if robot and plane:
            tolerance_position = tolerance_position or 0.001
            tolerance_xaxis = tolerance_xaxis or 1.
            tolerance_yaxis = tolerance_yaxis or 1.
            tolerance_zaxis = tolerance_zaxis or 1.

            frame = RhinoPlane.from_geometry(plane).to_compas_frame()
            tolerances_axes = [math.radians(tolerance_xaxis), math.radians(tolerance_yaxis), math.radians(tolerance_zaxis)]
            goal_constraints = robot.constraints_from_frame(frame, tolerance_position, tolerances_axes, group)

        return goal_constraints
# ---------- end constraints_from_plane ----------
deg = Degrees(Radians=panel_15)
panel_19 = Panel(deg)
button_2 = Button()  # disabled
plan_motion = PlanMotion(robot=data, goal_constraints=constraints_from_plane, start_configuration=config, compute=button_2)  # -> trajectory; inputs goal_constraints: list, attached_collision_meshes: list, path_constraints: list, compute: Boolean; disabled
#   port goal_constraints: The goal to be achieved, defined in a set of constraints. Constraints can be very specific, for example defining value domains for each joint, such that the goal configuration is included, or defining a volume in space, to which a specific robot link (e.g. the end-effector) is required to move to.
#   port start_configuration: The robot's full configuration, i.e. values for all configurable joints of the entire robot, at the starting position. Defaults to the all-zero configuration.
#   port group: The planning group used for calculation. Defaults to the robot's main planning group.
#   port attached_collision_meshes: A list of attached collision meshes to be included for planning.
#   port path_constraints: Optional constraints that can be imposed along the solution path. Note that path calculation won't work if the start_configuration violates these constraints. Defaults to None.
#   port planner_id: The name of the algorithm used for path planning. Defaults to 'RRTConnect'
#   port compute: If True, calculates a trajectory.
#   port trajectory: The calculated trajectory.
# ---------- plan_motion: Python ----------
"""
Calculate a motion path.

COMPAS FAB v0.27.0
"""
from ghpythonlib.componentbase import executingcomponent as component
from scriptcontext import sticky as st

from compas_fab.ghpython.components import create_id


class PlanMotion(component):
    def RunScript(self, robot, goal_constraints, start_configuration, group, attached_collision_meshes, path_constraints, planner_id, compute):

        key = create_id(self, 'trajectory')

        path_constraints = list(path_constraints) if path_constraints else None
        attached_collision_meshes = list(attached_collision_meshes) if attached_collision_meshes else None
        planner_id = str(planner_id) if planner_id else 'RRTConnect'

        if robot and robot.client and robot.client.is_connected and start_configuration and goal_constraints and compute:
            st[key] = robot.plan_motion(goal_constraints,
                                        start_configuration=start_configuration,
                                        group=group,
                                        options=dict(
                                            attached_collision_meshes=attached_collision_meshes,
                                            path_constraints=path_constraints,
                                            planner_id=planner_id,
                                        ))

        trajectory = st.get(key, None)
        return trajectory
# ---------- end plan_motion ----------
trajectory_visualize = TrajectoryVisualize(robot=data, trajectory=plan_motion)  # -> start_configuration, configurations, fraction, time, planes, P, V, A; disabled
#   port group: The planning group for which this trajectory was planned.
#   port trajectory: The calculated trajectory.
#   port start_configuration: The start configuration of the trajectory.
#   port configurations: The full configurations along the trajectory.
#   port fraction: Indicates the fraction of requested trajectory that was calculated, e.g. 1 means the full trajectory was found.
#   port time: The time which is needed to execute that trajectory at full speed.
#   port planes: The planes of the robot's end-effector.
#   port P: The positions along the trajectory
#   port V: The velocities along the trajectory
#   port A: The accelerations along the trajectory
# ---------- trajectory_visualize: Python ----------
"""
Visualizes a trajectory.

COMPAS FAB v0.27.0
"""
from compas_ghpython import draw_frame
from compas_ghpython import list_to_ghtree
from ghpythonlib.componentbase import executingcomponent as component


class TrajectoryVisualize(component):
    def RunScript(self, robot, group, trajectory):
        start_configuration = None
        configurations = []
        fraction = 0.
        time = 0.

        planes = []
        positions = []
        velocities = []
        accelerations = []

        if robot and trajectory:
            group = group or robot.main_group_name

            for c in trajectory.points:
                configurations.append(robot.merge_group_with_full_configuration(c, trajectory.start_configuration, group))
                frame = robot.forward_kinematics(c, group, options=dict(solver='model'))
                planes.append(draw_frame(frame))
                positions.append(c.positions)
                velocities.append(c.velocities)
                accelerations.append(c.accelerations)

            start_configuration = trajectory.start_configuration
            fraction = trajectory.fraction
            time = trajectory.time_from_start

        P = list_to_ghtree(list(zip(*positions)))
        V = list_to_ghtree(list(zip(*velocities)))
        A = list_to_ghtree(list(zip(*accelerations)))

        # return outputs if you have them; here I try it for you:
        return (start_configuration, configurations, fraction, time, planes, P, V, A)
# ---------- end trajectory_visualize ----------
number_slider_5 = Slider(0, range=0..100)  # disabled
list_item = ListItem(List=trajectory_visualize.configurations, Index=number_slider_5, Wrap=True)  # disabled
robot_visualize_3 = RobotVisualize(robot=data, configuration=list_item)  # -> visual, collision, collision_meshes, attached_meshes, frames, base_frame, ee_frame; inputs show_visual: Boolean, show_collision: Boolean, show_frames: Boolean, show_base_frame: Boolean, show_end_effector_frame: Boolean, show_cm: Boolean, show_acm: Boolean; disabled
#   port group: The planning group used for end-effector and base visualization.
#   port configuration: The robot's full configuration.
#   port show_visual: Whether or not to show the robot's visual meshes.
#   port show_collision: Whether or not to show the robot's collision meshes.
#   port show_frames: Whether or not to show the robot's joint frames.
#   port show_base_frame: Whether or not to show the robot's base frame.
#   port show_end_effector_frame: Whether or not to show the robot's end-effector frame.
#   port show_cm: Whether or not to show the collision meshes (if any).
#   port show_acm: Whether or not to show the attached collision meshes (if any).
#   port visual: Rhino meshes of the robot's visual geometry (if any).
#   port collision: Rhino meshes of the robot's collision geometry (if any).
#   port collision_meshes: Rhino meshes of the scene's collision meshes (if any).
#   port attached_meshes: Rhino meshes of the scene's attached collision meshes (if any).
#   port frames: The robot's joint frames as Rhino planes (if any).
#   port base_frame: The robot's base frame as a Rhino plane (if any).
#   port ee_frame: The robot's end-effector frame as a Rhino plane (if any).
# ---------- robot_visualize_3: Python ----------
"""
Visualizes the robot.

COMPAS FAB v0.27.0
"""
from compas.artists import Artist
from compas.geometry import Frame
from compas.geometry import Transformation
from compas_fab.robots import PlanningScene
from ghpythonlib.componentbase import executingcomponent as component


class RobotVisualize(component):
    def RunScript(
        self,
        robot,
        group,
        configuration,
        show_visual,
        show_collision,
        show_frames,
        show_base_frame,
        show_end_effector_frame,
        show_cm,
        show_acm,
    ):

        visual = None
        collision = None
        collision_meshes = None
        attached_meshes = None
        frames = None
        base_frame = None
        ee_frame = None

        if robot:
            show_visual = True if show_visual is None else show_visual
            show_cm = True if show_cm is None else show_cm
            show_acm = True if show_acm is None else show_acm
            configuration = configuration or robot.zero_configuration()

            robot.update(configuration, visual=show_visual, collision=show_collision)
            compas_frames = robot.transformed_frames(configuration, group)

            if show_visual:
                visual = robot.artist.draw_visual()

            if show_collision:
                collision = robot.artist.draw_collision()

            if show_base_frame:
                base_compas_frame = compas_frames[0]
                artist = Artist(base_compas_frame)
                base_frame = artist.draw()

            if show_end_effector_frame:
                ee_compas_frame = robot.forward_kinematics(
                    configuration, group, options=dict(solver="model")
                )
                artist = Artist(ee_compas_frame)
                ee_frame = artist.draw()

            if show_frames:
                frames = []
                for compas_frame in compas_frames[1:]:
                    artist = Artist(compas_frame)
                    frame = artist.draw()
                    frames.append(frame)

            if show_cm or show_acm:
                scene = PlanningScene(robot)
                scene = robot.client.get_planning_scene()

                collision_meshes = []
                attached_meshes = []

                if show_cm:
                    for co in scene.world.collision_objects:
                        header = co.header
                        frame_id = header.frame_id
                        cms = co.to_collision_meshes()

                        for cm in cms:
                            if cm.frame != Frame.worldXY():
                                t = Transformation.from_frame(cm.frame)
                                mesh = cm.mesh.transformed(t)
                            else:
                                mesh = cm.mesh

                            collision_meshes.append(Artist(mesh).draw())

                if show_acm:
                    for aco in scene.robot_state.attached_collision_objects:
                        for acm in aco.to_attached_collision_meshes():
                            frame_id = aco.object["header"]["frame_id"]
                            frame = robot.forward_kinematics(
                                configuration, options=dict(link=frame_id)
                            )
                            t = Transformation.from_frame(frame)

                            # Local CM frame
                            if (
                                acm.collision_mesh.frame
                                and acm.collision_mesh.frame != Frame.worldXY()
                            ):
                                t = t * Transformation.from_frame(
                                    acm.collision_mesh.frame
                                )

                            mesh = acm.collision_mesh.mesh.transformed(t)

                            attached_meshes.append(Artist(mesh).draw())

        return (
            visual,
            collision,
            collision_meshes,
            attached_meshes,
            frames,
            base_frame,
            ee_frame,
        )
# ---------- end robot_visualize_3 ----------
